% Simulink data dictionary Parameters.sldd

DAC_ON = Simulink.Variant(Condition="XIL == 1")
XIL = 0
DAC_OFF = Simulink.Variant(Condition="XIL == 0")
GRAVITY = -9.807
THETA_BALANCING = 0.39
TS = 0.01
THETA_WAIT = 0.22
THETA_SWING = 0.19
PENDULUM_LENGTH = 1
PENDULUM_MASS = 1
PENDULUM_RADIUS = 0.05
PENDULUM_FRICTION = 0.1
TORQUE_LEVEL = 0.5
TORQUE_GAIN = 10
INITIAL_POSITION = -3.141593
CONTROLLER_D = -44.3
CONTROLLER_I = -34.5
CONTROLLER_N = 105
CONTROLLER_P = -113.1